# Grasshopper definition Agent builder.gh (Grasshopper 1.0.8)

unit_z = UnitZ(Factor=Slider(0, range=0..500))
number_slider = Slider(1000, range=0..1000)
number_slider_2 = Slider(1000, range=0..1000)
number_slider_3 = Slider(50, range=0..100)
xy_plane = XYPlane(Origin=Point(0, 0, 0))
construct_domain = ConstructDomain(DomainStart=expr("-x/2", number_slider), DomainEnd=expr("x/2", number_slider))
construct_domain_2 = ConstructDomain(DomainStart=expr("-x/2", number_slider_2), DomainEnd=expr("x/2", number_slider_2))
move = Move(Geometry=xy_plane, Motion=unit_z)  # -> Geometry, Transform
rectangle = Rectangle(Plane=move.Geometry, XSize=construct_domain_2, YSize=construct_domain, Radius=0)  # -> Rectangle, Length
trigger = Trigger(Interval=20, TimerInterval=20, Target=boids_simulator)  # disabled
surface = Surface(rectangle.Rectangle)
number_slider_4 = Slider(30, range=10..50)
surface_generator = Python3Script(
    base_surface=surface,
    divU=number_slider_4,
    divV=number_slider_4,
    amplitude=Slider(100, range=0..150),
    frequency=Slider(1.7, range=0..3),
    phase=Slider(0, range=0..6.28),
    radial_strength=Slider(1.5, range=1..3),
    radial_falloff=Slider(3, range=0..3),
    noise_strength=Slider(1, range=0..3),
    seed=Slider(666, range=0..1000))  # -> surface, points, height, fields; inputs base_surface: Surface, divU: Int32, divV: Int32, amplitude: Int32, frequency: Double, phase: Double, radial_strength: Double, radial_falloff: Double, noise_strength: Double, seed: Int32
# ---------- surface_generator: Python ----------
"""
Assignment 4: Agent-Based Model for Surface Panelization

Author: Jesper Christensen Sørensen
"""

# -----------------------------------------------------------------------------
# Imports (extend as needed)
# -----------------------------------------------------------------------------
import rhinoscriptsyntax as rs
import numpy as np
import random

# Outputs
surface = None          # Rhino Surface
points = []             # list of 3D points
height = []             # flattened height field
fields = {}             # dictionary of geometric fields


# Set random seeds for reproducible results
def seed_everything(seed):
    if seed is None:
        return
    try:
        random.seed(seed)
        np.random.seed(seed)
    except Exception as e:
        raise RuntimeError(f"Failed to set random seeds: {e}")
    
# Generate normalized UV parameter grid
def uv_grid(divU, divV):
    # Create uniform UV samples in [0,1]x[0,1] for surface parametrization
    # UV space standardizes sampling over any surface domain
    u = np.linspace(0.0, 1.0, divU)
    v = np.linspace(0.0, 1.0, divV)

    U, V = np.meshgrid(u, v, indexing="ij")

    return U, V

# -----------------------------------------------------------------------------
# 1. Heightmap Generation
# -----------------------------------------------------------------------------
# Generate scalar height field from sinusoidal + radial + noise components
def heightmap(
    U, V,
    amplitude=1.0,
    frequency=1.0,
    phase=0.0,
    radial_strength=0.3,
    radial_falloff=4.0,
    anisotropy=1.0,
    noise_strength=0.0
):
    # Base sinusoidal field (global wave structure)
    H_wave = (
        np.sin(2.0 * np.pi * frequency * U + phase) *
        np.cos(2.0 * np.pi * frequency * anisotropy * V + phase)
    )

    # Radial attractor (creates central lift or depression)
    cx, cy = 0.5, 0.5
    r = np.sqrt((U - cx) ** 2 + (V - cy) ** 2)
    H_radial = np.exp(-radial_falloff * r)

    # Noise field (for organic variation)
    if noise_strength > 0.0:
        noise = np.random.rand(*U.shape) - 0.5
    else:
        noise = 0.0

    # Weighted combination of fields
    H = (
        (1.0 - radial_strength) * H_wave +
        radial_strength * H_radial +
        noise_strength * noise
    )
    return amplitude * H

# -----------------------------------------------------------------------------
# Field generation
# -----------------------------------------------------------------------------

def compute_height_field(H):
    """Return height scalar field."""
    return H


def compute_slope_field(H, U, V):
    """
    Compute slope (gradient) field from heightmap.
    Returns a vector field (du, dv) at each UV sample.
    """
    du = np.gradient(H, axis=0)
    dv = np.gradient(H, axis=1)
    return du, dv

# -------------------------------
# 2) Source point grid (planar or surface-sampled)
# -------------------------------

# Generate planar XY grid of points
def make_point_grid_xy(divU, divV, origin=(0.0, 0.0, 0.0), size=(100.0, 100.0)):
    ox, oy, oz = origin
    sx, sy = size

    U, V = uv_grid(divU, divV)

    point_grid = []
    for i in range(divU):
        row = []
        for j in range(divV):
            x = ox + U[i, j] * sx
            y = oy + V[i, j] * sy
            z = oz
            row.append(rs.CreatePoint(x, y, z))
        point_grid.append(row)

    return point_grid


 # Sample point grid directly from a NURBS surface
def sample_point_grid_from_surface(base_surface, U, V):
    # Sample points from surface using UV parameters
    # Maps normalized UV to actual surface domain for accurate sampling
    dom_u = rs.SurfaceDomain(base_surface, 0)
    dom_v = rs.SurfaceDomain(base_surface, 1)

    divU, divV = U.shape
    point_grid = []

    for i in range(divU):
        row = []
        for j in range(divV):
            u = dom_u[0] + U[i, j] * (dom_u[1] - dom_u[0])
            v = dom_v[0] + V[i, j] * (dom_v[1] - dom_v[0])
            pt = rs.EvaluateSurface(base_surface, u, v)
            row.append(pt)
        point_grid.append(row)

    return point_grid


# -------------------------------
# 3) Deform point grid (Z or surface normals)
# -------------------------------

 # Deform point grid vertically using heightmap
def manipulate_points_z(point_grid, H):
    divU = len(point_grid)
    divV = len(point_grid[0])

    new_grid = []
    for i in range(divU):
        row = []
        for j in range(divV):
            x, y, z = point_grid[i][j]
            # Offset point vertically by heightmap value for simple deformation
            row.append(rs.CreatePoint(x, y, z + H[i, j]))
        new_grid.append(row)

    return new_grid


 # Deform point grid along surface normals using heightmap
def manipulate_points_along_normals(point_grid, H, base_surface, U, V):
    # Offset points along surface normals scaled by heightmap
    # Creates deformation respecting surface curvature and orientation
    dom_u = rs.SurfaceDomain(base_surface, 0)
    dom_v = rs.SurfaceDomain(base_surface, 1)

    divU, divV = U.shape
    new_grid = []

    for i in range(divU):
        row = []
        for j in range(divV):
            u = dom_u[0] + U[i, j] * (dom_u[1] - dom_u[0])
            v = dom_v[0] + V[i, j] * (dom_v[1] - dom_v[0])

            p = point_grid[i][j]
            n = rs.SurfaceNormal(base_surface, (u, v))

            if not n or rs.VectorLength(n) < 1e-6:
                # If normal invalid or zero length, keep original point
                row.append(p)
            else:
                n_unit = rs.VectorUnitize(n)
                offset = rs.VectorScale(n_unit, H[i, j])
                row.append(rs.PointAdd(p, offset))

        new_grid.append(row)

    return new_grid

# -------------------------------
# 4) Construct canopy surface from points
# -------------------------------

 # Construct NURBS surface from point grid
def surface_from_point_grid(point_grid):
    # Create NURBS surface from point grid points
    rows = len(point_grid)
    if rows == 0:
        return None
    cols = len(point_grid[0])

    flat_points = []
    for i in range(rows):
        for j in range(cols):
            flat_points.append(point_grid[i][j])

    # Rhino expects points in (u,v) order, cols x rows grid
    srf = rs.AddSrfPtGrid((cols, rows), flat_points)

    return srf


### pipeline execution ###
seed_everything(seed)

# 1. UV grid
U, V = uv_grid(divU, divV)

# 2. Heightmap
H = heightmap(U, V, amplitude, frequency, phase, radial_strength, radial_falloff, noise_strength)

# -----------------------------------------------------------------------------
# Field construction
# -----------------------------------------------------------------------------

height_field = compute_height_field(H)
slope_u, slope_v = compute_slope_field(H, U, V)

fields = {
    "height": height_field,
    "slope_u": slope_u,
    "slope_v": slope_v,
    "U": U,
    "V": V
}

# 3. Point grid (planar or surface sampled)
if base_surface is not None:
    pts = sample_point_grid_from_surface(base_surface, U, V)
    pts_def = manipulate_points_along_normals(pts, H, base_surface, U, V)
else:
    pts = make_point_grid_xy(divU, divV)
    pts_def = manipulate_points_z(pts, H)

# 4. Surface construction from deformed points
surf = surface_from_point_grid(pts_def)

# Return outputs
surface = surf
points = [pt for row in pts_def for pt in row]
height = H.flatten().tolist()
fields = fields
# ---------- end surface_generator ----------
button = Button()
boids_builder = Python3Script(N=number_slider_3, reset=button)  # -> out, agents; inputs N: Int32, reset: Boolean
# ---------- boids_builder: Python ----------
import Grasshopper
import random
import rhinoscriptsyntax as rs


class Boid(object):
    def __init__(self, position):
        """
        position: [x, y, z] in [0,1]^3
        """
        self.position = position
        self.velocity = [
            random.uniform(-0.01, 0.01),
            random.uniform(-0.01, 0.01),
            0.0  # 2D motion in XY
        ]

    def __str__(self):
        return "Boid (Position:{0}, Velocity:{1})".format(self.position, self.velocity)

    # --------------- HELPER FUNCTIONS ---------------

    def dist(self, other):
        return rs.Distance(self.position, other.position)

    def sorted_neighbors(self, others):
        return sorted(others, key=self.dist)

    def _neighbors_in_radius(self, others, radius):
        neighbors = []
        sorted_others = self.sorted_neighbors(others)
        for other in sorted_others:
            if other is self:
                continue
            d = self.dist(other) #########
            if d < radius:
                neighbors.append(other)
            else:
                break
        return neighbors

    def _bounce(self):
        pos = list(self.position)
        vel = list(self.velocity)

        for i in range(len(pos)):
            if pos[i] < 0.0:
                pos[i] = 0.0
                vel[i] *= -1.0
            elif pos[i] > 1.0:
                pos[i] = 1.0
                vel[i] *= -1.0

        self.position = pos #########
        self.velocity = vel #########

    # --------------- BOID BEHAVIOR FUNCTIONS ---------------

    def _separation_force(self, neighbors, radius, separation_radius=0.05):
        if not neighbors:
            return [0.0, 0.0, 0.0]

        steer = [0.0, 0.0, 0.0]
        for other in neighbors:
            vec = rs.VectorCreate(self.position, other.position)  # self - other
            d = rs.VectorLength(vec)

            if d == 0:
                vec = [random.uniform(-1, 1),
                       random.uniform(-1, 1),
                       random.uniform(-1, 1)]
                d = rs.VectorLength(vec)

            t = max(0.0, min(d / separation_radius, 1.0))
            inv_t = 1.0 - t  # 1 at d = 0, 0 at d >= separation_radius

            vec = rs.VectorUnitize(vec)
            vec = rs.VectorScale(vec, inv_t)
            steer = rs.VectorAdd(steer, vec)

        return steer

    def _cohesion_force(self, neighbors, radius):
        if not neighbors:
            return [0.0, 0.0, 0.0]

        center = [0.0, 0.0, 0.0]
        for other in neighbors:
            center = rs.VectorAdd(center, other.position)
        center = [c / float(len(neighbors)) for c in center]

        # vector from self to center (center - self.position)
        desired = rs.VectorCreate(center, self.position) #########
        if rs.VectorLength(desired) == 0:
            return [0.0, 0.0, 0.0]

        desired = rs.VectorUnitize(desired)
        return desired

    def _alignment_force(self, neighbors, radius):
        if not neighbors:
            return [0.0, 0.0, 0.0]

        avg_vel = [0.0, 0.0, 0.0]
        for other in neighbors:
            avg_vel = rs.VectorAdd(avg_vel, other.velocity)
        avg_vel = [v / float(len(neighbors)) for v in avg_vel]

        if rs.VectorLength(avg_vel) == 0:
            return [0.0, 0.0, 0.0]

        desired = rs.VectorUnitize(avg_vel)
        return desired

    # --------------- STEER BEHAVIOR FUNCTION ---------------

    def steer(
        self,
        others,
        radius,
        separation_weight=1.0,
        cohesion_weight=1.0,
        alignment_weight=1.0,
        max_velocity=0.02
    ):
        neighbors = self._neighbors_in_radius(others, radius)
        
        sep = self._separation_force(others, radius)
        coh = self._cohesion_force(others, radius)
        ali = self._alignment_force(others, radius)

        steer = [0.0, 0.0, 0.0]
        steer = rs.VectorAdd(steer, rs.VectorScale(sep, separation_weight))
        steer = rs.VectorAdd(steer, rs.VectorScale(coh, cohesion_weight))
        steer = rs.VectorAdd(steer, rs.VectorScale(ali, alignment_weight))

        self.velocity = rs.VectorAdd(self.velocity, steer)

        if rs.VectorLength(self.velocity) > max_velocity:
            self.velocity = rs.VectorUnitize(self.velocity)
            self.velocity = rs.VectorScale(self.velocity, max_velocity)

    # --------------- BOID UPDATE FUNCTION ---------------

    def update(self):
        self.position = rs.VectorAdd(self.position, self.velocity)
        self.position = list(self.position)
        self._bounce()


def build_agents(n_agents, seed=None):
    if seed is not None:
        random.seed(seed)

    agents = []
    for _ in range(n_agents):
        x = random.uniform(0.0, 1.0)
        y = random.uniform(0.0, 1.0)
        z = 0.0  # 2D motion
        point = [x, y, z]
        agents.append(Boid(point))

    return agents

class MyComponent(Grasshopper.Kernel.GH_ScriptInstance):
    def RunScript(self, N: int, reset: bool):
        if reset or not hasattr(self, "agents"):
            self.agents = build_agents(N)
        return self
# ---------- end boids_builder ----------
boids_simulator = Python3Script(
    boids_component=boids_builder.agents,
    sep=Slider(10, range=0..10),
    coh=Slider(0.2, range=0..1),
    ali=Slider(1, range=0..1),
    rad=Slider(0.1, range=0..1),
    max_vel=Slider(0.02, range=0..1))  # -> out, positions, vectors
# ---------- boids_simulator: Python ----------
import rhinoscriptsyntax as rs

boids = boids_component.agents

for b in boids:
    b.steer(boids, rad, sep, coh, ali)
    b.update()

positions = [rs.AddPoint(b.position) for b in boids]
vectors   = [rs.AddPoint(b.velocity) for b in boids]
# ---------- end boids_simulator ----------
vdis = VectorDisplay(Anchor=boids_simulator.positions, Vector=boids_simulator.vectors)
con = DelaunayEdges(Points=boids_simulator.positions, Plane=PlaneXY(0, 0, 0))  # -> Connectivity, Edges
surface_2 = Surface(surface_generator.surface)
point = Point(surface_generator.points)
python_3_script = Python3Script(surface=surface_generator.surface, fields=surface_generator.height, n_agents=number_slider_3, reset=button)
